# Grasshopper definition assignment-01.gh (Grasshopper 1.0.8)

# ---- group: Auto-reloads cdf module on VScode changes
# Setting path for Src AutoReloader: 1. Right click on Path
# 2. Choose "Select a directory"
# 3. Locate the ..\cdf1_teaching\src folder in your computer
path = FilePath("/Users/ognyansarafov/Documents/workspace_ghub/cdf1_teaching/src/")
# NOTES:
# 
# - Use Python 3 Script blocks for your functions.
# - Import your functions and classes as: from cdf import my_function, My_class
# - Don't forget to add and name your INPUT and OUTPUT parameters that match your functions correctly. If you zoom in to the Python component you will see the + sign to add and - to remove them.
# - You need to attach the accurate components to your INPUT parameters: sliders for integers or floats, toggles or buttons for booleans, text for strings, Rhino geometries etc. etc.
# - If an INPUT is  a list, you need to right-click the parameter to set it as LIST access. Sometimes you need to also set the type of the INPUT by clicking TYPE HINT and selecting the correct input type.
# - If you want to hide an object, right-click component and uncheck Preview. To visualize again, check Preview.
# - If you get errors, READ THEM! They often tell what's wrong in a simple language. If not, copy-paste to CoPilot and don't be afraid to play around!
# 
# For more Grasshopper Help, go to:
# https://developer.rhino3d.com/guides/scripting/scripting-component/#script-inputs-and-outputs
autoreloader = Python3Script(src_path=path)  # -> out; inputs src_path: String
# ---------- autoreloader: Python ----------
#! python3
import sys, os, time
import scriptcontext as sc
import Rhino, System
from System.IO import FileSystemWatcher, NotifyFilters

VERSION = 1  
pkg = "cdf"

if not src_path:
    raise Exception("Connect a folder to src_path.")
path = os.path.normpath(src_path)
watch_dir = os.path.join(path, pkg)
if not os.path.isdir(watch_dir):
    raise Exception("No '{}' folder found in:\n{}".format(pkg, path))

def unload():
    for name in list(sys.modules):
        if name == pkg or name.startswith(pkg + "."):
            del sys.modules[name]

# Put this folder first in Python's search list
if path in sys.path:
    sys.path.remove(path)
sys.path.insert(0, path)

key = "cdf_watcher_" + str(ghenv.Component.InstanceGuid)
time_key = key + "_time"
version_key = key + "_version"

def stamp():
    sc.sticky[time_key] = time.strftime("%Y-%m-%d %H:%M:%S")

# Replace the old watcher if the folder changed or the script was updated
old = sc.sticky.get(key)
if old is not None and (os.path.normpath(old.Path) != watch_dir
                        or sc.sticky.get(version_key) != VERSION):
    old.Dispose()
    del sc.sticky[key]
    unload()

if key not in sc.sticky:
    comp = ghenv.Component
    last = [0.0]

    def reload_and_rerun():
        unload()
        stamp()
        doc = comp.OnPingDocument()
        if doc is None:            # reloader was deleted or the file closed
            return
        for obj in doc.Objects:
            if "Python" in obj.GetType().Name:
                obj.ExpireSolution(False)   # mark as out of date
        doc.NewSolution(False)              # recompute once

    def on_change(sender, e):
        if not e.FullPath.endswith(".py") or "__pycache__" in e.FullPath:
            return
        if time.time() - last[0] < 0.5:     # ignore the second event of a double save
            return
        last[0] = time.time()
        Rhino.RhinoApp.InvokeOnUiThread(System.Action(reload_and_rerun))

    w = FileSystemWatcher(watch_dir, "*.py")
    w.IncludeSubdirectories = True
    w.NotifyFilter = NotifyFilters.LastWrite
    w.Changed += on_change
    w.EnableRaisingEvents = True
    sc.sticky[key] = w
    sc.sticky[version_key] = VERSION
    stamp()                                  # time the watcher started

msg = "Last reloaded: {}\nWatching: {}".format(sc.sticky.get(time_key, "unknown"), watch_dir)
print(msg)
out = msg
# ---------- end autoreloader ----------
panel = Panel(autoreloader)

# ---- group: BAU-HAUS-ONION
xy = XYPlane(Origin=Point(0, 0, 0))
_3d_grid = Python3Script(
    cell_size=Slider(50, range=0..100),
    cells_x=Slider(10, range=0..10),
    cells_y=Slider(10, range=0..10),
    cells_z=Slider(10, range=0..10),
    plane=xy)  # -> out, vertices, centers, edges, cell_size_out; inputs plane: Plane
# ---------- _3d_grid: Python ----------
from cdf.geometry_basics import create_cube_grid

vertices, centers, edges, cell_size_out = create_cube_grid(
    cell_size, plane, cells_x, cells_y, cells_z
)
# ---------- end _3d_grid ----------
number_slider = Slider(31, range=0..100)
item = ListItem(List=_3d_grid.centers, Index=6, Wrap=True)
Z = UnitZ(Factor=1)
item_2 = ListItem(List=_3d_grid.centers, Index=Slider(999, range=0..999), Wrap=True)
prism = Python3Script(
    location=item,
    cell_size=_3d_grid.cell_size_out,
    grid_plane=xy,
    base_diameter=number_slider,
    vertices=Slider(6, range=0..10),
    height=number_slider,
    direction=Z)  # -> out, brep; inputs location: Point3d
# ---------- prism: Python ----------
from cdf.geometry_basics import place_prism

brep = place_prism(
    location,
    cell_size,
    base_diameter,
    vertices,
    height,
    direction,
    grid_plane,
)
# ---------- end prism ----------
sphere = Python3Script(location=item_2, cell_size=_3d_grid.cell_size_out, base_diameter=Slider(1, range=0..1))  # -> out, brep; inputs location: Point3d
# ---------- sphere: Python ----------
from cdf.geometry_basics import place_sphere

brep, color_hex_out = place_sphere(
    location,
    cell_size,
    base_diameter,
)
# ---------- end sphere ----------
sphere_shells = Python3Script(
    sphere_brep=sphere.brep,
    cell_size=_3d_grid.cell_size_out,
    sphere_count=number_slider,
    offset_cells=Slider(1, range=0..10),
    prism_brep=prism.brep,
    vertex_index=Slider(0, range=0..7),
    point_index=Slider(1, range=0..99))  # -> out, shells, diffuse, specular, emission, transparency, shine; inputs sphere_brep: Brep, prism_brep: Brep
# ---------- sphere_shells: Python ----------
from cdf.geometry_basics import create_sphere_shells

(
    shells,
    diffuse,
    specular,
    emission,
    transparency,
    shine,
) = create_sphere_shells(
    sphere_brep,
    cell_size,
    sphere_count,
    offset_cells,
    prism_brep,
    vertex_index,
    point_index,
)
# ---------- end sphere_shells ----------
material = CreateMaterial(
    Diffuse=sphere_shells.diffuse,
    Specular=sphere_shells.specular,
    Emission=sphere_shells.emission,
    Transparency=sphere_shells.transparency,
    Shine=sphere_shells.shine)
geo = Geometry(sphere_shells.shells)
preview = CustomPreview(Geometry=geo, Material=material)

# ---- group: custom components
_3d_grid_2 = Python3Script()  # -> out, vertices, centers, edges, cell_size_out; inputs plane: Plane; disabled; same code as _3d_grid
prism_2 = Python3Script()  # -> out, brep; inputs location: Point3d; disabled; same code as prism
cylinder = Python3Script()  # -> out, brep; inputs location: Point3d; disabled
# ---------- cylinder: Python ----------
from cdf.geometry_basics import place_cylinder

brep = place_cylinder(
    location,
    cell_size,
    base_diameter,
    height,
    direction,
)
# ---------- end cylinder ----------
sphere_2 = Python3Script()  # -> out, brep, color_hex_out; inputs location: Point3d; disabled
# ---------- sphere_2: Python ----------
from cdf.geometry_basics import place_sphere

brep = place_sphere(
    location,
    cell_size,
    base_diameter,
)
# ---------- end sphere_2 ----------
sphere_shells_2 = Python3Script()  # -> out, shells, diffuse, specular, emission, transparency, shine; inputs sphere_brep: Brep, prism_brep: Brep; disabled; same code as sphere_shells
